# Dynamo graph Generate Connectivity Graph.dyn (Dynamo 1.3.0.875)

all_elements_in_active_view = ElementsInView()
select_model_element = DSModelElementSelection()  # 1 picked in the model
id = Element.Id(select_model_element)
code_block = CodeBlock { 3; 7; false; false; false; }
directConnectedElements = DynamoGraphBuilder.GraphColoringMethod.DirectConnectedElements()
create = DynamoGraphBuilder.GraphConfiguration.Create(code_block.out0, code_block.out1, code_block.out2, code_block.out3, code_block.out4, directConnectedElements)
wholeBuilding = DynamoGraphBuilder.GraphBuilder.WholeBuilding(all_elements_in_active_view, create)
getDirectConnectedElementIds = DynamoGraphBuilder.GraphBuilder.GetDirectConnectedElementIds(id, wholeBuilding)
elementsByIds = DynamoGraphBuilder.GraphBuilder.ElementsByIds(all_elements_in_active_view, getDirectConnectedElementIds)
geometry = Element.Geometry(elementsByIds)
geometry_2 = Element.Geometry(select_model_element)
directConnectedStructuralElements = DynamoGraphBuilder.GraphColoringMethod.DirectConnectedStructuralElements()
allDependentElements = DynamoGraphBuilder.GraphColoringMethod.AllDependentElements()
getDirectConnectedStructuralElementsIds = DynamoGraphBuilder.GraphBuilder.GetDirectConnectedStructuralElementsIds()  # unwired: arg0, arg1
getAllDependentElementIds = DynamoGraphBuilder.GraphBuilder.GetAllDependentElementIds()  # unwired: arg0, arg1
